# Grasshopper definition 4_daylight_simulation_by_job.gh (Grasshopper 1.0.7)
# plug-ins: GH_CPython

gh_cpython = GH_CPython(input=Slider(69, range=69..99))  # -> geo_path, output; inputs input: list
#   port input: [required] - [type = int] - [default = None] Descripe your input here * bullet point. * bullet point
#   port output: indicate your output description here. refers to a new line.
# ---------- gh_cpython: Python ----------
import os
folder_path = "E:/_lab/code/residential daylight/indoor/job2/"
folders = os.listdir(folder_path)
geo_path = folder_path + folders[int(_input)]
output_ = folders[int(_input)]
# ---------- end gh_cpython ----------
ladybug = Ladybug_Ladybug()  # -> Vviiiiiiiiiizzz; plug-in component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
honeybee = Honeybee_Honeybee()  # -> Vviiiiiiiiiizzz; plug-in component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
python = GhPythonScript()  # -> out, a, room_srf, room_brep, window_srf, door_brep
# ---------- python: Python ----------
"""Provides a scripting component.
    Inputs:
        name: name of txt file
    Output:
        wall: external/internal walls with holes
        windows: list of windows
        a: an output variable
        """

__author__ = "hqs"
__version__ = "2021.0529"


import rhinoscriptsyntax as rs
import random
from Rhino.Geometry import Brep, BoundingBox, Point3d

# layout information
room_height = 3.000
door_height = 2.200
window_sill = 0.500
window_top = 2.400

ext_path = rs.AddLine([0, 0, 0], [0, 0, room_height])

# 读取户型文件
room = []

with open(model_path + "/room.csv") as file:
    for line in file:
        arr = line.split(',')
        r = []
        for num in arr[:-1]:
            r.append(float(num))
        room.append(r)

win = []
with open(model_path + "/window.csv") as file:
    for line in file:
        arr = line.split(',')
        r = []
        for num in arr[:4]:
            r.append(float(num))
        win.append(r)

door = []
door_thick = []
with open(model_path + "/door.csv") as file: 
    for line in file:
        arr = line.split(',')
        r = []
        for num in arr[:4]:
            r.append(float(num))
        door.append(r)
        door_thick.append(float(arr[4]))

# 绘制房间brep
room_brep = []
room_srf = []
for i in range(len(room)):
    pts = []
    for j in range(int(len(room[i]) / 2)):
        pts.append(rs.AddPoint(room[i][j*2], room[i][j*2+1], 0))

    pts.append(pts[0])
#    
    edges = rs.AddPolyline(pts)
    room_floor = rs.AddPlanarSrf(edges)
    room_brep.append(rs.ExtrudeSurface(room_floor, ext_path))
    room_srf.append(room_floor[0])

# 绘制窗户face
window_srf = []
for i in range(len(win)):
    wpts = []
    wpts.append(rs.AddPoint(win[i][0], win[i][1], window_sill))
    wpts.append(rs.AddPoint(win[i][2], win[i][3], window_sill))
    wpts.append(rs.AddPoint(win[i][2], win[i][3], window_top))
    wpts.append(rs.AddPoint(win[i][0], win[i][1], window_top))
    
    window = rs.AddSrfPt(wpts)
    window_srf.append(window)

# 绘制门洞brep
door_brep = []
for i in range(len(door)):
    if door[i][0] == door[i][2]:
        minx = min(door_thick[i] + door[i][0], door[i][0])
        maxx = max(door_thick[i] + door[i][0], door[i][0])
        miny = min(door[i][1], door[i][3])
        maxy = max(door[i][1], door[i][3])
        
        
    elif door[i][1] == door[i][3]:
        minx = min(door[i][0], door[i][2])
        maxx = max(door[i][0], door[i][2])
        miny = min(door_thick[i] + door[i][1], door[i][1])
        maxy = max(door_thick[i] + door[i][1], door[i][1])
    else:
        print("门洞坐标错误！不平行")
    
#    dpts = []
#    dpts.append(rs.AddPoint(minx, miny, 0))
#    dpts.append(rs.AddPoint(minx, maxy, 0))
#    dpts.append(rs.AddPoint(maxx, maxy, 0))
#    dpts.append(rs.AddPoint(maxx, miny, 0))
   
    p1 = Point3d(minx, miny, 0)
    p2 = Point3d(maxx, maxy, door_height)
    box = BoundingBox(p1, p2)
    door_brep.append(box.ToBrep())
    
#a = rs.BooleanUnion(room_brep, door_brep)
# ---------- end python ----------
grid_size = Panel("0.1")
sunion = SolidUnion(Breps=[python.room_brep, python.door_brep])
dim = Dimensions(Surface=python.room_srf)  # -> UDimension, VDimension
radglassmaterial = Honeybee_RadianceGlassMaterial(
    materialName="rad_mat_hqs_20200531",
    RTransmittance="0.996",
    GTransmittance="0.996",
    BTransmittance="0.996",
    refractiveIndex=1.52)  # -> avrgTrans, RADMaterial; plug-in component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
division = Division(A=dim.UDimension, B=grid_size)
division_2 = Division(A=dim.VDimension, B=grid_size)
createhbsrfs = Honeybee_createHBSrfs(geometry=sunion)  # -> readMe, simplify(HBSurface); plug-in component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
round = Round(Number=division)  # -> Nearest, Floor, Ceiling
round_2 = Round(Number=division_2)  # -> Nearest, Floor, Ceiling
divide = DivideDomain²(Domain=python.room_srf, UCount=round.Nearest, VCount=round_2.Nearest)
graft = GraftTree(Tree=python.room_srf, IncludeEmptyLists=True, IncludeNullItems=True)
addhbglz = Honeybee_addHBGlz(HBObj=createhbsrfs.HBSurface, childSurfaces=flatten(python.window_srf), RADMaterials=radglassmaterial.RADMaterial)  # -> HBObjWGLZ; plug-in component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
subsrf = Isotrim(Surface=graft, Domain=divide)
panel = Panel("https://energyplus.net/weather-download/asia_wmo_region_2/CHN//CHN_Beijing.Beijing.545110_CSWD/all")
path = FilePath("E:\_lab\code\residential daylight\")
move = Move(Geometry=subsrf, Motion="0,0,0.75")  # -> Geometry, Transform
evalsrf = EvaluateSurface(Surface=reparameterize(move.Geometry), Point="{0.5, 0.5, 0}")  # -> Point, Normal, UDirection, VDirection, Frame
graft_2 = GraftTree(Tree=graft, IncludeEmptyLists=True, IncludeNullItems=True)
incurve = PointInCurve(Point=evalsrf.Point, Curve=graft_2)  # -> Relationship, Point
brep = Brep(addhbglz)
epw_stat = Ladybug_OpenEPWAndSTATWeatherFiles(weatherFileURL=panel, workingDir=path)  # -> epwFile, statFile; plug-in component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
cull = CullPattern(List=evalsrf.Normal, CullPattern=incurve.Relationship)
cull_2 = CullPattern(List=evalsrf.Point, CullPattern=incurve.Relationship)
wires = BrepWireframe(Brep=brep, Density=-1)

# ---- group: surfaces for coloring!
cull_3 = CullPattern(List=move.Geometry, CullPattern=incurve.Relationship)

# ----
wires_2 = BrepWireframe(Brep=cull_3, Density=-1)
annualdaylightsimulation = Honeybee_AnnualDaylightSimulation(north="0", epwWeatherFile=epw_stat.epwFile, testPoints=cull_2, ptsVectors=cull, testMesh=cull_3)  # -> analysisRecipe; plug-in component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
toggle = BooleanToggle(True)
analysisperiod = Ladybug_AnalysisPeriod(fromHour="8", toHour="18")  # -> readMe, analysisPeriod; plug-in component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
toggle_2 = BooleanToggle(True)
rundaylightanalysis = Honeybee_RunDaylightSimulation(
    HBObjects=flatten(brep),
    analysisRecipe=annualdaylightsimulation,
    writeRad=toggle,
    runRad=toggle,
    numOfCPUs="8",
    workingDir=path,
    radFileName=gh_cpython.output,
    overwriteResults=True)  # -> readMe, analysisType, resultsUnit, results, testPts, resultFiles, radGeoFile, studyFolder, done; plug-in component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
occupancygenerator = Honeybee_DaysimOccupancyGenerator(occupancyPeriod=analysisperiod.analysisPeriod, dailyOffHours="-1", weekendDays="0", writeTheOcc=toggle_2)  # -> occupancyFile; plug-in component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
readannualresultsi = Honeybee_ReadAnnualResultI(
    illFilesAddress=rundaylightanalysis.resultFiles,
    testPoints=cull_2,
    ptsVectors=cull,
    occupancyFiles=occupancygenerator,
    DLAIllumThresholds=300,
    runIt=toggle_2)  # -> DLA, UDLI_Less_100, UDLI_100_2000, UDLI_More_2000, CDA, sDA, annualProfiles, htmReport; plug-in component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
